% Simulink data dictionary NFSDatabase.sldd

nfs = struct(
  unit="SI",
  inputunit="Imperial",
  weight=28184.44,
  altitude=9144,
  meanchord=1.667256,
  span=10.30224,
  refarea=16.90835328,
  crusevel=138.9888,
  q=4438.495,
  dynamicpressure=4426.81,
  pathangle=0,
  tdis=0,
  tmisalign=0,
  iH0=0,
  consumprate=0,
  gravityaccel=9.8067,
  I=[10826.21 0 0; 0 4509.451 0; 0 0 15162.11],
  Idot=repmat(0, 3, 3),
  attitude0=[0; 0.03409591; 0],
  angularvel0=[0; 0; 0],
  mass=2873.998,
  AR=6.277143,
  xcg=0.55019448,
  initialpos=[0; 0; -9144],
  aero=struct(
    e=0.85,
    k=0,
    cD1=0.03,
    cD0=0.02,
    cDu=0,
    cDalpha=0.25,
    cDM=0,
    cTx1=0.0298,
    cTxu=-0.07,
    cL1=0.378,
    cL0=0.2,
    cLu=0,
    cLalpha=5.15,
    cLalphadot=2,
    cLq=4.1,
    cLM=0,
    cm1=0,
    cm0=0.025,
    cmu=0,
    cmalpha=-0.7,
    cmalphadot=-6.95,
    cmq=-14.9,
    cmT1=0,
    cmTu=0,
    cmTalpha=0,
    cmM=0,
    cYbeta=-0.346,
    cYbetadot=0,
    cYp=-0.0827,
    cYr=0.3,
    clbeta=-0.0944,
    clbetadot=0,
    clp=-0.442,
    clr=0.0926,
    cnbeta=0.1106,
    cnbetadot=0,
    cnp=-0.0243,
    cnr=-0.139,
    cnTbeta=0,
    cDdelta_e=0,
    cDdelta_f=0,
    cDdelta_a=0,
    cDdelta_r=0,
    cLdelta_e=0.5,
    cLdelta_f=0,
    cmdelta_e=-1.12,
    cmdelta_f=0,
    cDiH=0,
    cLiH=0,
    cMiH=0,
    cYdelta_a=0,
    cYdelta_r=0.2,
    cldelta_a=0.181,
    cldelta_r=0.015,
    cndelta_a=-0.0254,
    cndelta_r=-0.0365,
    Xu=-0.01124287,
    XTu=-0.001948764,
    Xalpha=3.333617,
    Xw=0.02398479,
    Xdelta_e=-0,
    Zu=-0.1416601,
    Zalpha=-134.9073,
    Zw=-0.9706343,
    Zalphadot=-0.3124123,
    Zwdot=-0.002247752,
    Zq=-0.6404453,
    Zdelta_e=-13.02194,
    Mu=0,
    MTu=0,
    Malpha=-19.37175,
    Mw=-0.1393764,
    MTalpha=0,
    Malphadot=-1.153581,
    Mwdot=-0.008299814,
    Mq=-2.473145,
    Mdelta_e=-30.9948,
    Ybeta=-9.011183,
    Yv=-0.06483388,
    Yp=-0.07982392,
    Yr=0.2895668,
    Ydelta_a=0,
    Ydelta_r=5.208776,
    Lbeta=-6.723874,
    Lv=-0.04837709,
    Lp=-1.166787,
    Lr=0.2444446,
    Ldelta_a=12.89217,
    Ldelta_r=1.068412,
    Nbeta=5.624958,
    Nv=0.04047059,
    NTbeta=0,
    Nbetadot=0,
    Np=-0.04580283,
    Nr=-0.2619997,
    Ndelta_a=-1.291808,
    Ndelta_r=-1.856338,
    Lbetaprime=-6.723874,
    Lvprime=-0.04837709,
    Lpprime=-1.166787,
    Lrprime=0.2444446,
    Ldelta_aprime=12.89217,
    Ldelta_rprime=1.068412,
    Nbetaprime=5.624958,
    Nvprime=0.04047059,
    Npprime=-0.04580283,
    Nrprime=-0.2619997,
    Ndelta_aprime=-1.291808,
    Ndelta_rprime=-1.856338),
  Uncertainty=struct(
    Noise=struct(SampleTime=1, Power=0.1),
    Turbulence=struct(
      VonKarman=struct(Seed=[23341 23342 23343 23344], ScaleLength=762),
      Dryden=struct(Seed=[23341 23342 23343 23344], ScaleLength=533.4))),
  Coordinate=struct(Ref="NED", Lat=35.6892, Long=51.389, Alt=-1250),
  Measurement=struct(
    Rate=0.001,
    IMULoc=[0; 0; 0],
    Acc=struct(Seed=[23093; 23094; 23095], NoisePower=[1.0e-12; 1.0e-12; 1.0e-12], SFCC=[1 0 0; 0 1 0; 0 0 1]),
    Gyro=struct(Seed=[25402.3; 25403.4; 25404.5], NoisePower=[1.0e-12; 1.0e-12; 1.0e-12], SFCC=[1 0 0; 0 1 0; 0 0 1])),
  trim=struct(alpha=0.03409591, delta_e=0.001011487, thrust=4050.603),
  crusevelvec=[138.908; 0; 4.738031],
  desired=struct(height=-9144, pitch=0.03409591, phi=0, q=0),
  dyn=struct(
    long=struct(
      DynMat=sym(
        s="symobj::fromString(\"eJzVGk1sFFX4dXehLdBaGggiEBYRL5wg0QNEsrWl0NAFgRKJQTbTnbfbkdmZZWaWsiQmoBc4GA0RDdGEGwd/L8Zg4kETE6PGgzEmHiCePCiJB88mOO/NbOft9/5mf2jaTV52vvfz/b3v772ZLEIog9DV98L/XHZgTfhXeApFv2z4vCl+DuegYdL8pm/4vlV1aHfb+H7SFrHlmflLhmcZ8zbOO0YN+/mGj8285eT9Zs2df22qUas1Z0zsBFbFwh5iaWYAzhxpC65tgjkyHul833YD0L+WND8wbWue0luHkt8IaT4OTjdrE7Zl+NiPZNvK0PiRmd83hW0mTaqTdEp5Ju4PGSnsjp8HgJK6UViWtCm3BpVFFVk0As+6THmU0cyC5x8YHDkArwE0niDt8OW6h0PFuc60hYmoqLAtwUdp70zwEfq5cLwwmqBpw0lkylgm7WdprxfgKYZ9WcT9uHUsvEFhMFnAyyBpk64ThNtN8O6K+8fCdj3iAZmKPRsirYRDBfn4omjfTjQoXm6fTSMwBHK06OREuEpWBSnmRLzYxpVmyfUUPFO7KeGLDcOmutwejw3ELQt0PkA6H4U/hR1t0fmI49Z9QEuE50mdD0fyGQ41H92+2DiWkqPBwjsUcuUFc6G+ch34GpQ/I/LpSaNet5ucfCq/fVbAF4w7rH5oc+scDc7magaZVNiS4G7DyfKwF8DbBTzK4qBONs5nwwQy3XDKSENzvYYOpxNBXBrTxJtu4B3xM9mnVszZwMg3HPHbspMkLj16dG0I8XEJ6mwjkI3aRBDh4voF+ZD21xCni/WKGMnO26TRwXOPQac6eE8C9h13WhtTFT/keV0VO2HKiE1bvb9svhfimjpRLJ2eOzVz/Agdl+XEdaIY5OFL2KMGw9reVdb2uFjhBx5S6ALaJF1jY2J9vO1ZCEFcfHz3g1oQ5V3ZPBorSktVnzIecfsU8lYNFigfMG7nFGsjmmXXKRsBQvJ8Hc0L+a9GOlDna8sxcVTnsTIcU+AnBfGaUt1uxEW0THZIL1pXa9gBvw7G19Cm+Foh0hO3Ti2fZzhVzNGbE/Ddre+JfIKdP7nMMenFHtePAd+U1avQB1l4XOR71MzUtDvNsyx8bhnya7/1zsXWYnE2OTbI90GXE/tRD9FYOFkOT6/zro3S16Jp/YbGacOksYylS/vPFmdhP41rh21ci89U3NmvRgPSY7Mn0blqJdsTjbcveZYjiLcwN5Mz9aiDF8MjZ4CXVJwuR1PfNnka/bJDag8hb0iRG+lZ0PCqvoLOyzCnZOJ/JD97eAAeFcjI8iHT40q3GxauK/Y9bb0K8zTUI9Qbu8crXVdcjGTuA2R6S5s3z4t8ix7Z1b7F+cK8y8Vsdr32XsV3SZW+dD6HfgHrJRhnr2r0mF9l+xzVrjb245o3jX+83kHu2QngN5DujNJwRHdQun2BfgflWk17Quv7sou9clTfp6mVznfgR8OkkSvY/UEYzWl3T2cGVW1xY5XpnsbrC5hEprZ5E0h9f0BrOHJWmjk+R8ZkdweDAK/qTMLOKyn2BO7BZsV+Xdf40SiS1wyy+0g4T3yn4OCqERCDlq67KeCtm3cywjprskzvDET3sqIcwq6neSNo1rFoz8MqFFfpW6+e6nNOX4wtQXtZTn96p8f1N1LmFGF9MEdBqd6OKsZmFLars5/tIvsxo/eJLRyDwnxTNnwc8ayKp+f6JBPrH7pzCBf/iX1Nz56YmOP5hTGbpdNJrNmi8YkXFDkqvlMNGp7D8UfWjSRg29jdlLrtVA5lTVnxjLJA1gxq/x1keJbFwI8VtKiNeW7DEZxJoW4/BfAnKWn2EmfpPU/ZdchFeClwtTze6TBGqtYud53RTVzkYkp9wQr/dN8GDB7U4P5GMC76LgDmeR1OWQ0Dz8C3Nfw4KXOAq+FpUTN+eRXYAAv3ch/Bwk3N+JVVoBfWN2jun6KPSpt9C8Bvd0FX9b5QtXarBhbRgt8bcWc+5j0nu/ZQF3Ix/trTM4u3AOCfRDJMWqbobpC8l2p975XR6IK8Jx+LdHHgwIxTsRwraHaQGw4hwV0Wgwfy1avtc2cF06pUkPxcx9W5FQoqcyH/PVREQ6aTvYJcrZL7Ug+5+HkA/7rM8aZXGOavDfqcPPCfxg6oL1j+FezxdVA/8vP9HvLzfcXeDgv2lqvLGblkNeUgMwb5ITTa3ldkxfP+Qsl5nfD5dPK85DstPDFcyDHr6buzh7vG0ZE/HlygV7cJHZn8J0X+Gd8hcrhHvl2L3sfnvo7hFm7OV3eXzpYA/61vlbJMX0sGFW+ysVMAfijid2NjHF376OatKMQu8cvNu/X5MCrOH/ggUdnj5euXL4aQ9eXa7xK2xHwNPRhDI0Of3Sa37Kp5d86MoH1Hd3wYqX/pW0yWj39Wwn4U/s2hkd/vbkvMh6PHf/dRdxfjD88hfhZWvS/sme89xzaiN7/6/l5rH2L9cvPePYPQq1N//p18BiTer9Gfh9Fv+06+AubB/eLy7PTsxJH/AUgkopI=\", 2)"),
      ss=ss(
        a=[-0.01319163 0.02398479 0 -9.8067; -0.1416601 -0.9706343 138.3484 -0; 0.001175753 -0.1313203 -3.626727 0; 0 0 1 0],
        b=[-0; -13.02194; -30.88673; 0],
        c=[1 0 0 0; 0 1 0 0; 0 0 1 0; 0 0 0 1],
        d=[0; 0; 0; 0],
        StateName=uint64([1 2 4 1 1 1 1 5 23644245941747797 27303570963759208]),
        StateUnit=uint64([1 2 0 1]),
        Ts=0,
        InputName=uint64([1 2 1 1 2 6619236]),
        InputUnit=uint64([1 2 0 1]),
        OutputName=uint64([1 2 4 1 1 1 1 5 23644245941747797 27303570963759208]),
        OutputUnit=uint64([1 2 0 1]),
        Notes=uint64([1 2 0 1])),
      tf=tf(
        num={[0 0 -0.3123285 199.2741 277.2322]; [0 -13.02194 -4320.526 -56.99253 -43.05856]; [0 -30.88673 -28.67712 -0.4782338 -0]; [0 0 -30.88673 -28.67712 -0.4782338]},
        den={[1 4.610553 21.75221 0.3060537 0.1936242]; [1 4.610553 21.75221 0.3060537 0.1936242]; [1 4.610553 21.75221 0.3060537 0.1936242]; [1 4.610553 21.75221 0.3060537 0.1936242]},
        Ts=0,
        InputName=uint64([1 2 1 1 2 6619236]),
        InputUnit=uint64([1 2 0 1]),
        OutputName=uint64([1 2 4 1 1 1 1 5 23644245941747797 27303570963759208]),
        OutputUnit=uint64([1 2 0 1]),
        Notes=uint64([1 2 0 1])),
      wn=[0.09448854; 4.656941],
      zeta=[0.06465978; 0.4937075],
      zero={[639.4154; -1.38819]; [-331.77506508017143+0.0i; -0.0065807957797390862+0.099614922426833508i; -0.0065807957797390862-0.099614922426833508i]; [0; -0.9114736; -0.0169873]; [-0.9114736; -0.0169873]},
      pole=[-2.2991666585739656+4.049806215667294i; -2.2991666585739656-4.049806215667294i; -0.006109608421293539+0.094290807689459924i; -0.006109608421293539-0.094290807689459924i],
      gain=[-0.3123285; -13.02194; -30.88673; -30.88673],
      cheq=sym(
        s="symobj::fromString(\"eJxjZmBgYGJgaJgGpFmYGVmBlIMUAwQwA9kiUDZQDQMnCBdXFicWF2em54GFUeSNQLg8NbMoRaEssSgzMSknVSEvMTe1WKG0ODVFITNPobgyNz8py6U0N7fSMyU1ryQzLTO1iAHZTiY0M1lAOCM/JwVNDS43gtUX5+SXoImzgXBxSUpOZhLYPi4GBOAF4eLUkuDKXMeczMTi1GKI3ySR7DiFpJ5qASYKwjjDhLRAYUNTA3IYa3xBTmkxqlnoboSoyy3NKcF0HyMIQ/UzwTz/////K0BKG6TmKdAlVd4tMyBqUew4iRRerHjsB0dMfEF+OTQhIOsD+YkZic8IdQQjmntuwdxTALQpp9hVhUT3IMtxEnIDM3Y33IC5YQ4wTH7v1fYl4AaC9rBgt+cyzB4joI7EK7kgNiMAka9oRi==\", 2)"),
      correct=struct(
        cheq=sym(
          s="symobj::fromString(\"eJxjZmBgYGJgaJgGpFmYGVmBlIMUAwQwA9kiUDZQDQMnCBdXFicWF2em54GFUeSNQLg8NbMoRaEssSgzMSknVSEvMTe1WKG0ODVFITNPobgyNz8py6U0N7fSMyU1ryQzLTO1iAHZTiY0M1lAOCM/JwVNDS43gtUX5+SXoImzgXBxSUpOZhLYPi4GBOAF4eLUkuDKXMeczMTi1GKI3ySR7DiFpJ5qASYKwjjDhLRAYUNTA3IYa3xBTmkxqlnoboSoyy3NKcF0HyMIQ/WzIPkfFJisIAHjzIzG1cqT9q99aXjTn3fTXE7b2sVAYQUGTMCI5oaTSHKseNwHjrj4gvxyaEJB1gfyMzOyHUwIuzDcqw8kZt67YbHn3YL7i3/7yku4rXrzVXDpFAZIeFLiXmQ5TkJuZMbuRnCcSgcwMJy6ctgn6/4PMflX1vcU6OguFuzuAgUp08UtHAyZ29iOMAiguANZHTgd7as7LxWz/rh48pm5jHnzo078FT7jDVGL6Q8A1Oh7z7==\", 2)"),
        pole=[-2.2991666585741131-4.0498062156671875i; -2.2991666585741131+4.0498062156671875i; -0.0061096084212930862+0.094290807689460146i; -0.0061096084212930862-0.094290807689460146i],
        wn=[0.09448854; 4.656941],
        zeta=[0.06465978; 0.4937075])),
    lat=struct(
      DynMat=sym(
        s="symobj::fromString(\"eJzVGk1oHFX4ZXfT/LVpWhpitSWrVVF60YIiKY0bk6YGs41tAxYpXSY7b7ejszObmdkkWxCrgrSHongQPHnzEr158SZebBUREU9GPHlQvPQgiCh13pvZzNvvvXlvdmcbmoXHzvd+vr/3/b03k0UIZRC69qH/n8v29ft/hQdR8Mv6z4fCZ38OGiLNbbqa6xpVi3a3jZ8gbR0bjp5f0xxDWzFx3tJq2M03XKznDSvvNmv2ymtzjVqtuaBjyzMqBnYQSzMDcOZIu2KbOpgTxyOd75q2B/r3kOZ6ummsUHrDKPrtI83F3oVmbcY0NBe7gWyHGRrfMPN7prBx0mJ1kkwpj4b9PiOFY+FzH1BSNwrLkjZn16CyqCKLmucYG5THOJpZ8HybwZEDcD+gsZ+00xt1B/uKs615AxNRUeGhCB+lPRnhI/Rz/nhhNELThpPIlDF02s/SHhHgKfp9WcT9uHUsvFdiMFnAywBps7bl+dtN8D4c9o/57XrAA9IlezZIWgn7CnLxqmjflhoUL7fPuuZpAjladHIiXCWjgiRzAl5M7WqzZDsSnqndlPBqQzOpLo+EY31hywKd95HOu/5PYkcTKh+x7LoLaInwPKDy4UA+zaLmo9oXE4dScjRY+KhErrxgLtRXrgNfg/JnRD49q9XrZpOTT+a3jwv4gnGH1Q9tdp2jwdlcTSOTChMR7jacLA/HAXxEwGNcHFTJxvmsn0DmG1YZKWiOKOhwOhHEpTFFvOkGPho+k31qxZy9jHxDAb8tO4ni0t27bw0iPi5BnR0AslGb8AJcXL8gH9L+GuJ0MSKJkey8QwodPHMPdKqCH4vAnuNOamOy4oc8D1ex5aeM0LTl+8vmeyGuuaVi6cLy+YWzZ+h4XE4cFsUgB69hhxoMa3vXWNvjYoXrOUiiC2iTdI2JifXxtmcgBHHx8d31al6Qd+Pm0VhR2q76pPGI2yeft6p3hfIB43ZOsjagWbatsuYhFJ+vg3k+/9VAB/J8bVg6Duo8VoaXJPhJQdxfqpuNsIiOkx3SC9bVGqbHr4Px1bcpvlYI9MStk8vnaFYVc/SWBXx363sin2Dnz+5wTHoh5fox4Jtx9Sr0QRY+KPI9amZy2p3mWRa+tAP5tdd652JrsbgYHRvi90GVE3tRD9FYOFv2T68rtomS16JJ/YbGaU2nsYylS/svFhdhP41rp01cC89U3NmvRgPSPbMn0bnqfrYnGm9fdgxLEG9hbiZn6lELr/tHTg9vqzhZjqa+rfM0emWH1B583pAkN9KzoOZUXQmdV2BOyYT/KP7s4QB4VCAjy0ecHu93u2HhumTfk9arME9DPUK9sXt8v+uKi5HMfUCc3pLmzcsi36JHdrlvcb6wYnMxm12vvFdxbVKlb5/PoV/AegnG2WsKPeZ32T4HtauJ3bDmTeIfb3SQeyYB/DZSnVEalugOSrUv0O+gXLtpT2h9X7axUw7q+yS10uUO/GiINHIFe8LzozntTnVmkNUWN3aZ7mm8fh2TyNQ2bwbJ7w9oDUfOSgtnl8lY3N3BAMArO5Ow80qSPYF7MC7Zr+sKPxpF8TVD3H0knCe+U7BwVfOIQceu+0DAWzfvZIR11myZ3hmI7mVFOYRdT/OG16xj0Z77VSiu0rdeqepzTl+MLUF72Ul/ej/l+hsJc4qwPlimYKzeXpSMLUhsV2U/R0T2owfvE1s4BoT5pqy5OOBZFk8v9Ugm1j9U5xAu/hP7ml9cmlnm+YUxm6XTSayZUPjEKUmOCu9UvYZjcfyRdfsisG3sk4S67VQOaU1ZcbSyQNYMav+dZHiOi4GbElrUxhy7YQnOpFC3nwH404Q008RZes9Tti1yEV7ybCWPH3cYI2Vrd7rO6CYucjGlfsXw/1TfBgycVOD+UjAu+i4A5nkVzrgaBp6BP1LwYyXMAbaCp3XF+MYusAEWTnMfwcJNxfjVXaAX1jdo7p+jj1KbvQng97qgK3tfKFt7WAGLaMHvjbgzH/Oek1073YVcjL+membxFgD8rUiGWUMX3Q2S91Kt770yCl2Q9+RjgS6mphasimEZXrOD3DCNBHdZDB7IV1rb584KulGpoPhzHVfnVigozYX891ABjTidHBfkapncayly8bMA/nGH401aGOavveqc3Pevwg6oLxjuVezwdVAv8vNWivy8JdnbIcHecnU5I1dcTTnAjEF+CI229xVZ8bzfUXReJ3w+Ej1vf+uTZfpCfyrkGBz0/dk/z4+g76feuR6A29/mcfOWvtiD1r9+94foswXpPcE5ydh5kZ+Hd5Es3eCce6EPrWa26XF8bWWG0O3bb24BvriYcKx0sdSBnmS8s/CfIp5+2epHp6bH/6NX4hFP3epKSe/JzYPo1/qt54L0IKTHfyNRt9fDj7QhfhaWvVtLzfcfNzNo/YmvfqOvBiK+uXmj3w2hn54+92prj0MbZfHf6cHeppanuDKIJjKXZoA87Lq/09L4a2ES9deP/tyyLcW3tIlwPrU5iA58Prk/Mh+O7zuiXD6/OHPmf02Rro0=\", 2)"),
      ss=ss(
        a=[-0.06483388 0 -138.9888 9.8067 0
         -0.04837709 -1.166787 0.2444446 0 0
         0.04047059 -0.04580283 -0.2619997 0 0
         0 1 0 0 0
         0 0 1 0 0],
        b=[0 5.208776; 12.89217 1.068412; -1.291808 -1.856338; 0 0; 0 0],
        c=[1 0 0 0 0
         0 1 0 0 0
         0 0 1 0 0
         0 0 0 1 0
         0 0 0 0 1],
        d=repmat(0, 5, 2),
        StateName=uint64([1 2 5 1 1 1 1 3 3 22518350329413718 32369965925990504 105]),
        StateUnit=uint64([1 2 0 1]),
        Delay=struct(Input=[0; 0], Output=repmat(0, 5, 1), Internal=[]),
        Ts=0,
        InputName=uint64([1 2 2 1 2 2 32088576848101476]),
        InputUnit=uint64([1 2 0 1]),
        OutputName=uint64([1 2 5 1 1 1 1 3 3 22518350329413718 32369965925990504 105]),
        OutputUnit=uint64([1 2 0 1]),
        Notes=uint64([1 2 0 1])),
      tf=tf(
        num={[0 0 179.5468 417.9953 30.02783], [0 5.208776 265.4524 319.9728 -1.704876]
         [0 12.89217 3.89782 64.03051 0], [0 1.068412 -0.3565642 -6.497771 0]
         [0 -1.291808 -2.181516 -0.1360061 4.503824], [0 -1.856338 -2.124439 0.1139032 -0.4566486]
         [0 0 12.89217 3.89782 64.03051], [0 0 1.068412 -0.3565642 -6.497771]
         [0 0 -1.291808 -2.181516 -0.1360061 4.503824], [0 0 -1.856338 -2.124439 0.1139032 -0.4566486]},
        den={[1 1.493621 6.034486 7.366068 0.02728194], [1 1.493621 6.034486 7.366068 0.02728194]
         [1 1.493621 6.034486 7.366068 0.02728194], [1 1.493621 6.034486 7.366068 0.02728194]
         [1 1.493621 6.034486 7.366068 0.02728194], [1 1.493621 6.034486 7.366068 0.02728194]
         [1 1.493621 6.034486 7.366068 0.02728194], [1 1.493621 6.034486 7.366068 0.02728194]
         [1 1.493621 6.034486 7.366068 0.02728194 0], [1 1.493621 6.034486 7.366068 0.02728194 0]},
        Delay=struct(Input=[0; 0], Output=repmat(0, 5, 1), IO=repmat(0, 5, 2)),
        Ts=0,
        InputName=uint64([1 2 2 1 2 2 32088576848101476]),
        InputUnit=uint64([1 2 0 1]),
        OutputName=uint64([1 2 5 1 1 1 1 3 3 22518350329413718 32369965925990504 105]),
        OutputUnit=uint64([1 2 0 1]),
        Notes=uint64([1 2 0 1])),
      wn=[0; 0.003715028; 1.27586; 2.399137],
      zeta=[-1; 0.04460893; 1],
      zero={[-2.253854; -0.07420281], [-49.72707; -1.240772; 0.00530484]
       [0.0+0.0i; -0.15117001496356239+2.2234581039663746i; -0.15117001496356239-2.2234581039663746i], [0; 2.638617; -2.304884]
       [-1.3941154362490318+1.1078740714776616i; -1.3941154362490318-1.1078740714776616i; 1.0994997898073127+0.0i], [-1.3296991890454077+0.0i; 0.092637159246635042+0.42002185342336978i; 0.092637159246635042-0.42002185342336978i]
       [-0.15117001496356255+2.2234581039663759i; -0.15117001496356255-2.2234581039663759i], [2.638617; -2.304884]
       [-1.394115436249038+1.1078740714776587i; -1.394115436249038-1.1078740714776587i; 1.0994997898073131+0.0i], [-1.3296991890454097+0.0i; 0.092637159246635042+0.42002185342337078i; 0.092637159246635042-0.42002185342337078i]},
      pole=[0.0+0.0i; -0.10702294634075898+2.3967487910357517i; -0.10702294634075898-2.3967487910357517i; -1.2758600430296188+0.0i; -0.0037150278245216008+0.0i],
      gain=[179.5468 5.208776; 12.89217 1.068412; -1.291808 -1.856338; 12.89217 1.068412; -1.291808 -1.856338],
      cheq=sym(
        s="symobj::fromString(\"eJxjZmBgYGJgaJgGpFmYGVmBlIMUAwQwA9kiUDZQDQMnCBdXFicWF2em54GFUeSNQLg8NbMoRaEssSgzMSknVSEvMTe1WKG0ODVFITNPobgyNz8py6U0N7fSMyU1ryQzLTO1iAHZTiY0M1lAOCM/JwVNDS43gtUX5+SXoImzgXBxSUpOZhLYPi4GBOAF4eLUkuDKXMeczMTi1GKI3ySR7DiFpJ5qASYKwjjDhLRAYUNTA3IYa3xBTmkxqlnoboSoyy3NKcF0HyMIQ/UzwTz/////C0BKG6TmN9DWjH2/PkHUothxEim8WPHYD46Y+IL8cmhCQNYH8hMzEp8R6ghGNPfcgLknlp2BQeX9vG0kugdZjpOQG5gJuIEDqEOpSuIKLd3Agt0N12Bu+Ak0nU3mWDkBNxC0hxVKAwAZE23r\", 2)"),
      correct=struct(
        cheq=sym(
          s="symobj::fromString(\"eJxjZmBgYGJgaJgGpFmYGVmBlIMUAwQwA9kiUDZQDQMnCBdXFicWF2em54GFUeSNQLg8NbMoRaEssSgzMSknVSEvMTe1WKG0ODVFITNPobgyNz8py6U0N7fSMyU1ryQzLTO1iAHZTiY0M1lAOCM/JwVNDS43gtUX5+SXoImzgXBxSUpOZhLYPi4GBOAF4eLUkuDKXMeczMTi1GKI3ySR7DiFpJ5qASYKwjjDhLRAYUNTA3IYa3xBTmkxqlnoboSoyy3NKcF0HyMIQ/WzIPkfrKdC4xRzsP+dc5Wru6b6PDy9nrGCxwOqBx0wotl/EtUsnG4DR1p8QX45NJEg6wP5lxnZDiaEXSyo6hhY/wOJ+1V1+YxTT+9We/ulJm/a2UPJl0wXgAyl0L3IcpyE3MiM3Y3g+Lylsqy+LTFPpSJW6Fbq1pxHDALqdHMXC3Z3gdQw8QMJj7fzrjFO2mHJwNAhTGu3sGJ3CzgthgQzMhRCIpoRABn/eRg=\", 2)"),
        pole=[0.0+0.0i; -1.2765777003405028+0.0i; -0.0037203598708189026+0.0i; -0.10666145166216738-2.3936714144704561i; -0.10666145166216738+2.3936714144704561i],
        wn=[0; 0.00372036; 1.276578; 2.396047],
        zeta=[-1; 0.0445156; 1])),
    linsys=ss(
      a=[-0.01319163 0.02398479 0 -9.8067 0 0 0 0 0
       -0.1416601 -0.9706343 138.3484 -0 0 0 0 0 0
       0.001175753 -0.1313203 -3.626727 0 0 0 0 0 0
       0 0 1 0 0 0 0 0 0
       0 0 0 0 -0.06483388 0 -138.9888 9.8067 0
       0 0 0 0 -0.04837709 -1.166787 0.2444446 0 0
       0 0 0 0 0.04047059 -0.04580283 -0.2619997 0 0
       0 0 0 0 0 1 0 0 0
       0 0 0 0 0 0 1 0 0],
      b=[-0 0 0
       -13.02194 0 0
       -30.88673 0 0
       0 0 0
       0 0 5.208776
       0 12.89217 1.068412
       0 -1.291808 -1.856338
       0 0 0
       0 0 0],
      c=[1 0 0 0 0 0 0 0 0
       0 1 0 0 0 0 0 0 0
       0 0 1 0 0 0 0 0 0
       0 0 0 1 0 0 0 0 0
       0 0 0 0 1 0 0 0 0
       0 0 0 0 0 1 0 0 0
       0 0 0 0 0 0 1 0 0
       0 0 0 0 0 0 0 1 0
       0 0 0 0 0 0 0 0 1],
      d=repmat(0, 9, 3),
      StateName=uint64([1 2 9 1 1 1 1 5 1 1 1 3 3 23644245941747797 27303570963759208 22518350329413718 32369965925990504 105]),
      StateUnit=uint64([1 2 0 1]),
      Delay=struct(Input=[0; 0; 0], Output=repmat(0, 9, 1), Internal=[]),
      Ts=0,
      InputName=uint64([1 2 3 1 2 2 2 27303502244282468 7471204]),
      InputUnit=uint64([1 2 0 1]),
      OutputName=uint64([1 2 9 1 1 1 1 5 1 1 1 3 3 23644245941747797 27303570963759208 22518350329413718 32369965925990504 105]),
      OutputUnit=uint64([1 2 0 1]),
      Notes=uint64([1 2 0 1]))),
  ctrl=struct(
    lqr=struct(
      long=struct(K=[0.8316521 -0.6730689 -2.773498 -43.53694]),
      lat=struct(K=[0.2713373 24.50842 0.016256 21.82277 19.9934; 7.054837 -0.4040486 -25.37322 1.411679 -0.5136919]))))

TurbulenceSelector = 0
NavigationSelector = 0